# Grasshopper definition hb_RhinoToRevit.gh (Grasshopper 0.9.76)
# plug-ins: Hummingbird

brep = Brep(<brep referenced from the Rhino model>)
debrep = DeconstructBrep(Brep=brep)  # -> Faces, Edges, Vertices
boxprop = BoxProperties(Box=brep)  # -> Center, Diagonal, Area, Volume, Degeneracy

brep_2 = Brep([<brep referenced from the Rhino model> x87])
debrep_2 = DeconstructBrep(Brep=brep_2)  # -> Faces, Edges, Vertices
pt = Point(debrep_2.Vertices)
panel = Panel(pt)
panel_2 = Panel("C:\Users\hans.palacios\Documents\My Files\01_DTM\Tickets\20170208 - Rhino To Revit\RhinoExport")
loftforms = LoftForms(WriteToggle=Toggle(False), FolderPath=panel_2, CsvFileName="wallsPrecast", Points=pt, LoftMode=1)  # -> Output, Data
panel_3 = Panel(loftforms.Data)
panel_4 = Panel(loftforms.Output)

division = Division(A=boxprop.Volume, B=boxprop.Area)
division_2 = Division(A=division, B="2")
vec = VectorXYZ(XComponent=0, YComponent=0, ZComponent=division_2)  # -> Vector, Length

# ---- group: Graft to add branch to align with other tree
move = Move(Geometry=boxprop.Center, Motion=vec.Vector)  # -> graft(Geometry), Transform

# ----
Z = UnitZ(Factor=1)

# ---- group: True - Export
toggle = BooleanToggle(False)

# ---- group: Loft Forms Test
brep_3 = Brep([<brep referenced from the Rhino model> x528])
brep_4 = Brep([<brep referenced from the Rhino model> x5])
debrep_3 = DeconstructBrep(Brep=brep_4)  # -> Faces, Edges, Vertices
pt_2 = Point(debrep_3.Vertices)
crv = Curve(debrep_3.Edges)
srf = Surface(debrep_3.Faces)
cp = ControlPoints(Curve=crv)  # -> Points, Weights, Knots
panel_5 = Panel("C:\Users\hans.palacios\Documents\My Files\01_DTM\Tickets\20170208 - Rhino To Revit\RhinoExport")
panel_6 = Panel(cp.Points)
loftforms_2 = LoftForms(WriteToggle=toggle, FolderPath=panel_5, CsvFileName="glazing2", Points=cp.Points, LoftMode=1)  # -> Output, Data

# ----
project = ProjectPoint(Point=move.Geometry, Direction=Z, Geometry=debrep.Faces)  # -> Point, Index
panel_7 = Panel(move.Geometry)
item = ListItem(List=debrep.Faces, Index=project.Index, Wrap=True)
panel_8 = Panel(project.Index)
srf_2 = Surface(item)
panel_9 = Panel(loftforms_2.Output)
panel_10 = Panel(loftforms_2.Data)

# ---- group: True - Export
toggle_2 = BooleanToggle(False)

toggle_3 = BooleanToggle(False)

# ----
panel_11 = Panel("C:\Users\hans.palacios\Documents\My Files\01_DTM\Tickets\20170208 - Rhino To Revit\RhinoExport")
panel_12 = Panel("C:\Users\hans.palacios\Documents\My Files\01_DTM\Tickets\20170208 - Rhino To Revit\RhinoExport")

# ---- group: True - Export
toggle_4 = BooleanToggle(False)

toggle_5 = BooleanToggle(False)

# ----
brep_5 = Brep([<brep referenced from the Rhino model> x19])
debrep_4 = DeconstructBrep(Brep=brep_5)  # -> Faces, Edges, Vertices
boxprop_2 = BoxProperties(Box=brep_5)  # -> Center, Diagonal, Area, Volume, Degeneracy
division_3 = Division(A=boxprop_2.Volume, B=boxprop_2.Area)
division_4 = Division(A=division_3, B="2")
vec_2 = VectorXYZ(XComponent=0, YComponent=0, ZComponent=division_4)  # -> Vector, Length
Z_2 = UnitZ(Factor=1)

# ---- group: Graft to add branch to align with other tree
move_2 = Move(Geometry=boxprop_2.Center, Motion=vec_2.Vector)  # -> graft(Geometry), Transform

# ----
project_2 = ProjectPoint(Point=move_2.Geometry, Direction=Z_2, Geometry=debrep_4.Faces)  # -> Point, Index
panel_13 = Panel(move_2.Geometry)
item_2 = ListItem(List=debrep_4.Faces, Index=project_2.Index, Wrap=True)
panel_14 = Panel(project_2.Index)
srf_3 = Surface(item_2)

# ---- group: Surfaces1 - Surfaces for each floor slab from RH model
srf_4 = Surface(flatten(srf_3))
panel_15 = Panel(srf_4)

# ---- group: Level1 - Extract points from surfaces & isolate Z coordinate to identify level above ground plane
srfpt = SurfacePoints(Surface=srf_4)  # -> Points, Weights, Greville, UCount, VCount
panel_16 = Panel("""True
False
False
False""")
dispatch = Dispatch(List=srfpt.Points, DispatchPattern=panel_16)  # -> ListA, ListB
pdecon = Deconstruct(Point=dispatch.ListA)  # -> XComponent, YComponent, ZComponent
Z_3 = UnitZ(Factor=pdecon.ZComponent)
vlen = VectorLength(Vector=Z_3)
trim = TrimTree(Tree=vlen, Depth=1)
panel_17 = Panel(trim)

# ---- group: Floor1 - Extract curves from surfaces & join individual curves into closed curves per level
edges = BrepEdges(Brep=srf_4)  # -> Naked, Interior, NonManifold
crv_2 = Curve(edges.Naked)
join = JoinCurves(Curves=crv_2, Preserve=Toggle(False))
trim_2 = TrimTree(Tree=join, Depth=1)
simplify = SimplifyCurve(Curve=trim_2)  # -> Curve, Simplified
panel_18 = Panel(simplify.Curve)

# ----
dcon = DeleteConsecutive(Set=trim, Wrap=False)  # -> Set, Count
trunc = Truncate(Input=dcon.Set, TruncationFactor=0)
panel_19 = Panel(trunc)

# ---- group: Level1 - Extract number of floors & use as Level Names (Add 1 to shift index from 0)
trim_3 = TrimTree(Tree=simplify.Curve, Depth=1)
lng = ListLength(List=trim_3)
series = Series(Start=0, Step=1, Count=lng)
addition = Addition(A=series, B="1")
concat = Concatenate(FragmentA="Level ", FragmentB=addition)
unflatten = UnflattenTree(Tree=concat, Guide=simplify.Curve)
trim_4 = TrimTree(Tree=unflatten, Depth=1)
panel_20 = Panel(trim_4)

# ---- group: Floor1 - Export
panel_21 = Panel("C:\Users\hans.palacios\Documents\My Files\01_DTM\Tickets\20170208 - Rhino To Revit\RhinoExport")
floors = Floors(
    WriteToggle=Toggle(False),
    FolderPath=panel_21,
    CsvFileName="floors",
    RevitTypeName="Concrete Slab",
    DataTreeSource=simplify.Curve)  # -> Output, Data
panel_22 = Panel(floors.Output)
panel_23 = Panel(floors.Data)

# ----
item_3 = ListItem(List=trunc, Index="-1", Wrap=True)
panel_24 = Panel(item_3)

# ---- group: Level1 - Export
panel_25 = Panel("C:\Users\hans.palacios\Documents\My Files\01_DTM\Tickets\20170208 - Rhino To Revit\RhinoExport")
levels = Levels(WriteToggle=toggle_3, FolderPath=panel_25, CsvFileName="levels", LevelElevation=trunc, LevelName=trim_4)  # -> Output, Data
panel_26 = Panel(levels.Data)
panel_27 = Panel(levels.Output)

# ----
brep_6 = Brep([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])
# This instance has the correct methodology
# for extracting surfaces from the floor plates.
debrep_5 = DeconstructBrep(Brep=brep_6)  # -> Faces, Edges, Vertices
boxprop_3 = BoxProperties(Box=brep_6)  # -> Center, Diagonal, Area, Volume, Degeneracy
division_5 = Division(A=boxprop_3.Volume, B=boxprop_3.Area)
division_6 = Division(A=division_5, B="2")
vec_3 = VectorXYZ(XComponent=0, YComponent=0, ZComponent=division_6)  # -> Vector, Length
Z_4 = UnitZ(Factor=1)

# ---- group: Graft to add branch to align with other tree
move_3 = Move(Geometry=boxprop_3.Center, Motion=vec_3.Vector)  # -> graft(Geometry), Transform

# ----
project_3 = ProjectPoint(Point=move_3.Geometry, Direction=Z_4, Geometry=debrep_5.Faces)  # -> Point, Index
panel_28 = Panel(move_3.Geometry)
item_4 = ListItem(List=debrep_5.Faces, Index=project_3.Index, Wrap=True)
panel_29 = Panel(project_3.Index)
srf_5 = Surface(item_4)

# ----
# This has to be flattened because the
# surface list from the previous process
# was grafted 1 tree branch too much.  This
# allows the levels to be created.
srf_6 = Surface(flatten(srf_5))
panel_30 = Panel(srf_6)
join_2 = BrepJoin(Breps=srf_6)  # -> Breps, Closed
srf_7 = Surface(join_2.Breps)

# ---- group: Level1 - Extract points from surfaces & isolate Z coordinate to identify level above ground plane
srfpt_2 = SurfacePoints(Surface=srf_7)  # -> Points, Weights, Greville, UCount, VCount
panel_31 = Panel("""True
False
False
False""")
dispatch_2 = Dispatch(List=srfpt_2.Points, DispatchPattern=panel_31)  # -> ListA, ListB
pdecon_2 = Deconstruct(Point=dispatch_2.ListA)  # -> XComponent, YComponent, ZComponent
Z_5 = UnitZ(Factor=pdecon_2.ZComponent)
vlen_2 = VectorLength(Vector=Z_5)
trim_5 = TrimTree(Tree=vlen_2, Depth=1)
panel_32 = Panel(trim_5)

# ---- group: Floor1 - Extract curves from surfaces & join individual curves into closed curves per level
edges_2 = BrepEdges(Brep=srf_7)  # -> Naked, Interior, NonManifold
crv_3 = Curve(edges_2.Naked)
join_3 = JoinCurves(Curves=crv_3, Preserve=Toggle(False))
trim_6 = TrimTree(Tree=join_3, Depth=1)
simplify_2 = SimplifyCurve(Curve=trim_6)  # -> Curve, Simplified
panel_33 = Panel(simplify_2.Curve)

# ----
dcon_2 = DeleteConsecutive(Set=trim_5, Wrap=False)  # -> Set, Count
trunc_2 = Truncate(Input=dcon_2.Set, TruncationFactor=0)

# ---- group: Level1 - Extract number of floors & use as Level Names (Add 1 to shift index from 0)
trim_7 = TrimTree(Tree=simplify_2.Curve, Depth=1)
lng_2 = ListLength(List=trim_7)
series_2 = Series(Start=0, Step=1, Count=lng_2)
addition_2 = Addition(A=series_2, B="1")
concat_2 = Concatenate(FragmentA="Level ", FragmentB=addition_2)
unflatten_2 = UnflattenTree(Tree=concat_2, Guide=simplify_2.Curve)
trim_8 = TrimTree(Tree=unflatten_2, Depth=1)
panel_34 = Panel(trim_8)

# ----
panel_35 = Panel(trunc_2)

# ---- group: Floor1 - Export
panel_37 = Panel("C:\Users\hans.palacios\Documents\My Files\01_DTM\Tickets\20170208 - Rhino To Revit\RhinoExport")
floors_2 = Floors(
    WriteToggle=Toggle(False),
    FolderPath=panel_37,
    CsvFileName="floors2",
    RevitTypeName="Concrete Slab",
    DataTreeSource=simplify_2.Curve)  # -> Output, Data
panel_38 = Panel(floors_2.Output)
panel_39 = Panel(floors_2.Data)

# ----
item_5 = ListItem(List=trunc_2, Index="-1", Wrap=True)
panel_40 = Panel(item_5)

# ---- group: Level1 - Export
panel_41 = Panel("C:\Users\hans.palacios\Documents\My Files\01_DTM\Tickets\20170208 - Rhino To Revit\RhinoExport")
levels_2 = Levels(WriteToggle=toggle_2, FolderPath=panel_41, CsvFileName="levels2", LevelElevation=trunc_2, LevelName=trim_8)  # -> Output, Data
panel_42 = Panel(levels_2.Data)
panel_43 = Panel(levels_2.Output)

# ----
brep_7 = Brep(<brep referenced from the Rhino model>)
# CORE - Large
debrep_6 = DeconstructBrep(Brep=brep_7)  # -> Faces, Edges, Vertices
boxprop_4 = BoxProperties(Box=brep_7)  # -> Center, Diagonal, Area, Volume, Degeneracy
division_7 = Division(A=boxprop_4.Volume, B=boxprop_4.Area)
division_8 = Division(A=division_7, B="2")
vec_4 = VectorXYZ(XComponent=0, YComponent=0, ZComponent=division_8)  # -> Vector, Length

# ---- group: Graft to add branch to align with other tree
move_4 = Move(Geometry=boxprop_4.Center, Motion=vec_4.Vector)  # -> Geometry, Transform

# ----
project_4 = ProjectPoint(Point=move_4.Geometry, Direction=Vector(0, 0, -1), Geometry=debrep_6.Faces)  # -> Point, Index
panel_44 = Panel(move_4.Geometry)
item_6 = ListItem(List=debrep_6.Faces, Index=project_4.Index, Wrap=True)
panel_45 = Panel(project_4.Index)
srf_8 = Surface(item_6)
edges_3 = BrepEdges(Brep=srf_8)  # -> graft(Naked), Interior, NonManifold

crv_4 = Curve(edges_3.Naked)
walls = Walls(
    WriteToggle=toggle_4,
    FolderPath=panel_11,
    CsvFileName="core2",
    Curves=crv_4,
    RevitTypeName="Core Wall",
    RevitWallHeight=item_5)  # -> Output, Data
panel_46 = Panel(walls.Data)
panel_47 = Panel(walls.Output)

brep_8 = Brep(<brep referenced from the Rhino model>)
# CORE - Small
debrep_7 = DeconstructBrep(Brep=brep_8)  # -> Faces, Edges, Vertices
boxprop_5 = BoxProperties(Box=brep_8)  # -> Center, Diagonal, Area, Volume, Degeneracy
division_9 = Division(A=boxprop_5.Volume, B=boxprop_5.Area)
division_10 = Division(A=division_9, B="2")
vec_5 = VectorXYZ(XComponent=0, YComponent=0, ZComponent=division_10)  # -> Vector, Length

# ---- group: Graft to add branch to align with other tree
move_5 = Move(Geometry=boxprop_5.Center, Motion=vec_5.Vector)  # -> Geometry, Transform

# ----
project_5 = ProjectPoint(Point=move_5.Geometry, Direction=Vector(0, 0, -1), Geometry=debrep_7.Faces)  # -> Point, Index
panel_48 = Panel(move_5.Geometry)
item_7 = ListItem(List=debrep_7.Faces, Index=project_5.Index, Wrap=True)
panel_49 = Panel(project_5.Index)
srf_9 = Surface(item_7)
edges_4 = BrepEdges(Brep=srf_9)  # -> graft(Naked), Interior, NonManifold

crv_5 = Curve(edges_4.Naked)
walls_2 = Walls(
    WriteToggle=toggle_5,
    FolderPath=panel_12,
    CsvFileName="core",
    Curves=crv_5,
    RevitTypeName="Core Wall",
    RevitWallHeight=item_3)  # -> Output, Data
panel_50 = Panel(walls_2.Data)
panel_51 = Panel(walls_2.Output)
